# Grasshopper definition 03_spiralLine.gh (Grasshopper 1.0.7)

path = FilePath("D:\p4r-homework\front-end\p4r-demo\gh-03-spiralLine.py")
pt = Point(Point(0, 0, 0))
file = ReadFile(File=path, PerLineParse=False)
int = Integer(Slider(28, range=10..100))
python = GhPythonScript(code=file, p0=pt, b=Slider(3.997, range=0..5), c=Slider(2.905, range=2..4), steps=int)  # -> out, pts, a
# ---------- python: Python ----------
__author__ = "admini"
__version__ = "2020.07.17"

import rhinoscriptsyntax as rs
import math

pts = []


def drawLine(p0, steps):
    for t in range(steps):
        x = (t**b) * math.cos((t/c)*(math.pi/6)+t/c)
        y = -(t**b) * math.sin((t/c)*(math.pi/6)+t/c) 
        p1 = (x, y, 0)
        pts.append(rs.AddPoint(p1))
    return pts


def drawLineByPts(result, pts):
    for i in range(len(pts)):
        j = i + 1
        if i + 1 == len(pts):
            break
        result.append(rs.AddLine(pts[i], pts[j]))
    return result


a = []
drawLine(p0, steps)
drawLineByPts(a, pts)
# ---------- end python ----------

path_2 = FilePath("D:\p4r-homework\front-end\p4r-demo\gh-03-spiralLine.py")
pt_2 = Point(Point(0, 0, 0))
file_2 = ReadFile(File=path_2, PerLineParse=False)
int_2 = Integer(Slider(28, range=10..100))
python_2 = GhPythonScript(code=file_2, p0=pt_2, b=Slider(3.997, range=0..5), c=Slider(2.905, range=2..4), steps=int_2)  # -> out, pts, a
# ---------- python_2: Python ----------
__author__ = "admini"
__version__ = "2020.07.17"

import rhinoscriptsyntax as rs
import math

pts = []


def drawLine(p0, steps):
    for t in range(steps):
        x = (t**b) * math.cos((t/c)*(math.pi/6)+t/c)
        y = -(t**b) * math.sin((t/c)*(math.pi/6)+t/c) 
        p1 = (x, y, 0)
        pts.append(p1)
    return pts


def drawLineByPts(result, pts):
    for i in range(len(pts)):
        j = i + 1
        if i + 1 == len(pts):
            break
        result.append(rs.AddLine(pts[i], pts[j]))
    return result


a = []
drawLine(p0, steps)
drawLineByPts(a, pts)
# ---------- end python_2 ----------

path_3 = FilePath("D:\p4r-homework\front-end\mega\gh-homework-spiralComplex.py")
pt_3 = Point(python.pts)
crv = Curve(python.a)
file_3 = ReadFile(File=path_3, PerLineParse=True)
lng = ListLength(List=pt_3)
int_3 = Integer(lng)
python_3 = GhPythonScript(code=file_3, pts=pt_3, length=int_3)  # -> out, a
# ---------- python_3: Python ----------
__author__ = "admini"
__version__ = "2020.07.17"

import rhinoscriptsyntax as rs


def draw(result, p0, p1, n=4):
    if n == 0:       
        result.append(rs.AddLine(p0, p1))
    elif n >= 1:
        p01 = rs.PointAdd(p0, rs.PointScale(rs.PointSubtract(p1,p0), 1/3))
        p10 = rs.PointAdd(p0, rs.PointScale(rs.PointSubtract(p1,p0), 2/3))
        p2 = rs.PointAdd(p01, rs.VectorRotate(rs.PointSubtract(p10, p01), 60, (0, 0, 1)))
        draw(p0, p01, n-1)
        draw(p01, p2, n-1)
        draw(p2, p10, n-1)
        draw(p10, p1, n-1)
    


def drawResult(result, pts):
    for i in range(length):
        j = i + 1
        if i + 1 == length:
            break
            
        p0 = pts[i]
        p1 = pts[j]
        draw(result, p0, p1)

a = []
drawResult(a, pts)
# ---------- end python_3 ----------
