# Grasshopper definition 04-homework_facade01.gh (Grasshopper 1.0.7)

pt = Point([Point(-23.34937764, -2.540394041, 0), Point(80.46066109, -75.35761884, 0), Point(213.7384138, -85.99079402, 0), Point(370.5903875, -64.63605363, 0), Point(517.6648568, 6.912485505, 0)])
pt_2 = Point([Point(-224.8524446, 247.3154466, 0), Point(-200.8343892, 169.4186867, 0), Point(-194.0575956, 29.48146404, 0), Point(-222.9875993, -107.5261914, 0)])
nurbs = NurbsCurve(Vertices=pt, Degree=3, Periodic=False)  # -> Curve, Length, Domain
nurbs_2 = NurbsCurve(Vertices=pt_2, Degree=3, Periodic=False)  # -> Curve, Length, Domain
crv = Curve(nurbs.Curve)
crv_2 = Curve(nurbs_2.Curve)
flip = FlipCurve(Curve=crv)  # -> Curve, Flag
planar = Planar(Curve=crv_2)  # -> Planar, Plane, Deviation
Z = UnitZ(Factor=1)
pframes = PerpFrames(Curve=flip.Curve, Count=Slider(28, range=0..100), Align=True)  # -> Frames, Parameters
align = AlignPlane(Plane=planar.Plane, Direction=Z)  # -> Plane, Angle
cull = CullPattern(List=pframes.Frames, CullPattern=[True, False])
cull_2 = CullPattern(List=pframes.Frames, CullPattern=[False, True])
Z_2 = UnitZ(Factor=1)
pt_3 = Point(pframes.Frames)
prot = RotatePlane(Plane=align.Plane, Angle=Slider(7.83, range=0..10))
Z_3 = UnitZ(Factor=1)
Z_4 = UnitZ(Factor=1)
align_2 = AlignPlane(Plane=pframes.Frames, Direction=Z_2)  # -> Plane, Angle
cull_3 = CullPattern(List=pt_3, CullPattern=[False, True])
cull_4 = CullPattern(List=pt_3, CullPattern=[True, False])
align_3 = AlignPlane(Plane=cull, Direction=Z_4)  # -> Plane, Angle
align_4 = AlignPlane(Plane=cull_2, Direction=Z_3)  # -> Plane, Angle
dist = Distance(PointA=cull_4, PointB=cull_3)
sqrt = SquareRoot(Value=3)
orient = Orient(Geometry=crv_2, Source=prot, Target=align_2.Plane)  # -> Geometry, Transform
orient_2 = Orient(Geometry=crv_2, Source=prot, Target=align_4.Plane)  # -> Geometry, Transform
orient_3 = Orient(Geometry=crv_2, Source=prot, Target=align_3.Plane)  # -> Geometry, Transform
multiplication = Multiplication(A=dist, B=sqrt)
divlength = DivideLength(Curve=orient.Geometry, Length=multiplication)  # -> Points, Tangents, Parameters
flip_2 = FlipMatrix(Data=orient.Geometry)
path = FilePath("D:\p4r-homework\front-end\mega\gh-homework_facade01.gh")
flip_3 = FlipMatrix(Data=orient_2.Geometry)
flip_4 = FlipMatrix(Data=orient_3.Geometry)
curvature = Curvature(Curve=flip_2, Parameter=divlength.Parameters)  # -> P, K, C
file = ReadFile(F=path, PerLineParse=False)  # -> C
#   port F: Uri of file to read
# ---------- file: VB line parser ----------
    action = GH_LineParserAction.Include
    Return line

    'Parse the line and return some data that represents the line.
    'If the line cannot be parsed, you can return Nothing and
    'assign a different action.
    'The default implementation is to just return the line itself.
    'If you return types that implement IGH_Goo, this component
    'will work substantially faster.
# ---------- end file ----------

divlength_2 = DivideLength(Curve=orient_3.Geometry, Length=multiplication)  # -> Points, Tangents, Parameters
divlength_3 = DivideLength(Curve=orient_2.Geometry, Length=multiplication)  # -> Points, Tangents, Parameters

python = GhPythonScript(code=file, p=curvature.P, k=curvature.K)  # -> out, surface, point, middle, center, line; inputs p: tree of Point3d, k: tree of Vector3d
# ---------- python: Python ----------
__author__ = "admini"
__version__ = "2020.07.23"

import rhinoscriptsyntax as rs
import ghpythonlib.treehelpers as th
import math


def draw_result(points, ks):
    surfaces = []
    tri_points = []
    mid_points = []
    cen_points = []

    line0 =[]

    for x in range(points.BranchCount-2):
        for y in range(points.Branch(x).Count-1):
            if x>=0 and y >=0:
                if x % 2 == 0:
                    p0 = points.Branch(x)[y]
                    p1 = points.Branch(x+2)[y]
                    p2 = points.Branch(x+1)[y+1]
                    p3 = points.Branch(x+3)[y+1]
                    p4 = points.Branch(x+2)[y+2]
                    p5 = points.Branch(x)[y+2]

                    pline0 = rs.AddLine(p0, p1)
                    pline1 = rs.AddLine(p1, p2)
                    pline2 = rs.AddLine(p2, p0)
                    pline3 = rs.AddLine(p1, p3)
                    pline4 = rs.AddLine(p3, p2)
                    pline5 = rs.AddLine(p2, p1)

                    line0.append(pline0)
                    line0.append(pline1)
                    line0.append(pline2)
                    line0.append(pline3)
                    line0.append(pline4)
                    line0.append(pline5)
                    
                    pline01 = rs.AddLine(p2, p4)
                    pline02 = rs.AddLine(p4, p5)
                    pline03 = rs.AddLine(p5, p2)
                    pline04 = rs.AddLine(p2, p3)
                    pline05 = rs.AddLine(p3, p4)
                    pline06 = rs.AddLine(p4, p2)

                    line0.append(pline01)
                    line0.append(pline02)
                    line0.append(pline03)
                    line0.append(pline04)
                    line0.append(pline05)
                    line0.append(pline06)

                
                    m01 = rs.VectorDivide(rs.VectorCreate(p1, p0), 2.0)
                    print(m01)
                    print(type(m01))
                    m12 = rs.VectorDivide(rs.VectorCreate(p2, p1), 2.0)
                    m20 = rs.VectorDivide(rs.VectorCreate(p2, p0), 2.0)
                    m13 = rs.VectorDivide(rs.VectorCreate(p3, p1), 2.0)
                    m32 = rs.VectorDivide(rs.VectorCreate(p2, p3), 2.0)
                    m21 = rs.VectorDivide(rs.VectorCreate(p1, p2), 2.0)

                    m52 = rs.VectorDivide(rs.VectorCreate(p2, p5), 2.0)
                    m24 = rs.VectorDivide(rs.VectorCreate(p4, p2), 2.0)
                    m45 = rs.VectorDivide(rs.VectorCreate(p5, p4), 2.0)
                    m23 = rs.VectorDivide(rs.VectorCreate(p3, p2), 2.0)
                    m34 = rs.VectorDivide(rs.VectorCreate(p4, p3), 2.0)
                    m42 = rs.VectorDivide(rs.VectorCreate(p2, p4), 2.0)
                    
                    cen_point0 = (p2-m01) / 3.0
                    cen_point1 = rs.VectorScale(rs.VectorCreate(p3, m21), (2.0/3.0))
                    cen_point2 = rs.VectorScale(rs.VectorCreate(p5, m24), (2.0/3.0))
                    cen_point3 = rs.VectorScale(rs.VectorCreate(p2, m34), (2.0/3.0))
                    dist = rs.Distance(p1, p0)

                    tri_points.append([p0, p1, p2])
                    tri_points.append([p1, p3, p2])
                    tri_points.append([p2, p4, p5])
                    tri_points.append([p2, p3, p4])

                    x_mid01_vector = (1+math.sin((x/points.BranchCount) * 2.0 * math.pi)) * \
                        (dist/5.0)*rs.VectorUnitize(rs.VectorCreate(cen_point0, m01))
                    x_mid01_point = rs.PointAdd(m01, x_mid01_vector))
                    print(type(x_mid01_vector))
                    print(type(x_mid01_point))

                    y_mid20_vector = (1+math.sin((x/points.BranchCount)*2.0 * math.pi)) * \
                        (dist/5.0)*rs.VectorUnitize(rs.VectorCreate(cen_point0, m20))
                    y_mid20_point = rs.PointAdd(m20, rs.VectorAdd(m20, y_mid20_vector))
                    
                    print(y_mid20_vector)
                    print(y_mid20_point)

                    y_mid12_vector = (1+math.sin((x/points.BranchCount)*2 * math.pi)) * \
                        (dist/5)*rs.VectorUnitize(rs.VectorCreate(cen_point0, m12))
                    y_mid12_point = rs.PointAdd(m12, rs.VectorAdd(m12, y_mid12_vector))
                    

                    x_mid32_vector = (1+math.sin((x/points.BranchCount) * 2 * math.pi)) * \
                        (dist/5)*rs.VectorUnitize(rs.VectorCreate(cen_point1, m32))
                    x_mid32_point = rs.AddPoint(rs.VectorAdd(m32, x_mid32_vector))

                    y_mid21_vector = (1+math.sin((x/points.BranchCount) * 2 * math.pi)) * \
                        (dist/5)*rs.VectorUnitize(rs.VectorCreate(cen_point1, m21))
                    y_mid21_point = rs.AddPoint(rs.VectorAdd(m21, y_mid21_vector))

                    y_mid13_vector = (1+math.sin((x/points.BranchCount) * 2 * math.pi)) * \
                        (dist/5)*rs.VectorUnitize(rs.VectorCreate(cen_point1, m13))
                    y_mid13_point = rs.AddPoint(rs.VectorAdd(m13, y_mid13_vector))

                    y_mid52_vector = (1+math.sin((x/points.BranchCount) * 2 * math.pi)) * \
                        (dist/5)*rs.VectorUnitize(rs.VectorCreate(cen_point2, m52))
                    y_mid52_point = rs.AddPoint(rs.VectorAdd(m52, y_mid52_vector))

                    y_mid24_vector = (1+math.sin((x/points.BranchCount) * 2 * math.pi)) * \
                        (dist/5)*rs.VectorUnitize(rs.VectorCreate(cen_point2, m24))
                    y_mid24_point = rs.AddPoint(rs.VectorAdd(m24, y_mid24_vector))

                    x_mid45_vector = (1+math.sin((x/points.BranchCount) * 2 * math.pi)) * \
                        (dist/5)*rs.VectorUnitize(rs.VectorCreate(cen_point2, m45))
                    x_mid45_point = rs.AddPoint(rs.VectorAdd(m45, x_mid45_vector))

                    x_mid23_vector = (1+math.sin((x/points.BranchCount) * 2 * math.pi)) * \
                        (dist/5)*rs.VectorUnitize(rs.VectorCreate(cen_point3, m23))
                    x_mid23_point = rs.AddPoint(rs.VectorAdd(m23, x_mid23_vector))

                    y_mid34_vector = (1+math.sin((x/points.BranchCount) * 2 * math.pi)) * \
                        (dist/5)*rs.VectorUnitize(rs.VectorCreate(cen_point3, m34))
                    y_mid34_point = rs.AddPoint(rs.VectorAdd(m34, y_mid34_vector))

                    y_mid42_vector = (1+math.sin((x/points.BranchCount) * 2 * math.pi)) * \
                        (dist/5)*rs.VectorUnitize(rs.VectorCreate(cen_point3, m42))
                    y_mid42_point = rs.AddPoint(rs.VectorAdd(m42, y_mid42_vector))
                    


                    mid_points.append([(m01, x_mid01_point),
                                    (m12, y_mid12_point),
                                    (m20, y_mid20_point),
                                    (m13, y_mid13_point),
                                    (m32, x_mid32_point),
                                    (m21, y_mid21_point),
                                    (m24, y_mid24_point),
                                    (m45, x_mid45_point),
                                    (m52, y_mid52_point),
                                    (m23, x_mid23_point),
                                    (m34, y_mid34_point),
                                    (m42, y_mid42_point)
                                    ])

                    x_axis = rs.VectorCreate(p1, p0)
                    y_axis = rs.VectorCreate(p2, m01)
                    z_axis = (dist/2.5)*rs.VectorUnitize(rs.VectorCrossProduct(y_axis, x_axis))

                    cen_above_point0 = rs.AddPoint(cen_point0, z_axis)
                    cen_above_point1 = rs.AddPoint(cen_point1, z_axis)
                    cen_above_point2 = rs.AddPoint(cen_point2, z_axis)
                    cen_above_point3 = rs.AddPoint(cen_point3, z_axis)

                    cen_points.append([cen_point0, cen_above_point0])
                    cen_points.append([cen_point1, cen_above_point1])
                    cen_points.append([cen_point2, cen_above_point2])
                    cen_points.append([cen_point3, cen_above_point3])

                    surf = []
                    surf.append(rs.AddSrfPt((p0, x_mid01_point, cen_above_point0)))
                    surf.append(rs.AddSrfPt((cen_above_point0, x_mid01_point, p1)))

                    surf.append(rs.AddSrfPt((p1, y_mid12_point, cen_above_point0)))
                    surf.append(rs.AddSrfPt((p2, cen_above_point0, y_mid12_point)))

                    surf.append(rs.AddSrfPt((p2, y_mid20_point, cen_above_point0)))
                    surf.append(rs.AddSrfPt((p0, cen_above_point0, y_mid20_point)))

                    surf.append(rs.AddSrfPt((p1, cen_above_point1, y_mid21_point)))
                    surf.append(rs.AddSrfPt(p2, y_mid21_point, cen_above_point1))

                    surf.append(rs.AddSrfPt((p1, y_mid13_point, cen_above_point1)))
                    surf.append(rs.AddSrfPt((p3, cen_above_point1, y_mid13_point)))

                    surf.append(rs.AddSrfPt(p3, x_mid32_point, cen_above_point1))
                    surf.append(rs.AddSrfPt((p2, cen_above_point1, x_mid32_point)))

                    surf.append(rs.AddSrfPt((p2, y_mid24_point, cen_above_point2)))
                    surf.append(rs.AddSrfPt((p4, cen_above_point2, y_mid24_point)))

                    surf.append(rs.AddSrfPt((p4, x_mid45_point, cen_above_point2)))
                    surf.append(rs.AddSrfPt((p5, cen_above_point2, x_mid45_point)))

                    surf.append(rs.AddSrfPt((p5, y_mid52_point, cen_above_point2)))
                    surf.append(rs.AddSrfPt((p2, cen_above_point2, y_mid52_point)))

                    surf.append(rs.AddSrfPt((p2, x_mid23_point, cen_above_point2)))
                    surf.append(rs.AddSrfPt((p3, cen_above_point2, x_mid23_point)))

                    surf.append(rs.AddSrfPt((p3, y_mid34_point, cen_above_point3)))
                    surf.append(rs.AddSrfPt((p4, cen_above_point3, y_mid34_point)))

                    surf.append(rs.AddSrfPt((p4, y_mid42_point, cen_above_point3)))
                    surf.append(rs.AddSrfPt((p2, cen_above_point3, y_mid42_point)))

                    surfaces.append(surf)
    
    return(surfaces, tri_points, mid_points, cen_points, line0)


surfaces, tri_points, mid_points, cen_points, line0 = draw_result(p, k)

surface = th.list_to_tree(surfaces, source=[0,0])
point = th.list_to_tree(tri_points, source=[0,0])
middle = th.list_to_tree(mid_points, source=[0,0])
center = th.list_to_tree(cen_points, source=[0,0])
line = th.list_to_tree(line0, source=[0,0])
# ---------- end python ----------
path_2 = FilePath("D:\p4r-homework\front-end\mega\gh-homework_facade01.gh")
curvature_2 = Curvature(Curve=flip_3, Parameter=divlength_3.Parameters)  # -> P, K, C
curvature_3 = Curvature(Curve=flip_4, Parameter=divlength_2.Parameters)  # -> P, K, C
file_2 = ReadFile(File=path_2, PerLineParse=False)
python_2 = GhPythonScript(code=file_2, p=curvature_3.P, k=curvature_3.K, pt=curvature_2.P, kt=curvature_2.K)  # -> out, surface, point, middle, center, line; inputs p: tree of Point3d, k: tree of Vector3d; unedited script template
